% Simulink data dictionary controlVariablesData.sldd

R_lqr = 1
Q_lqr = [25 0 0 0; 0 100 0 0; 0 0 8.207016 0; 0 0 0 100]

Q_aug_lqr = [2500 0 0 0 0 0
 0 100 0 0 0 0
 0 0 32.82806 0 0 0
 0 0 0 100 0 0
 0 0 0 0 1 0
 0 0 0 0 0 1]

R_aug_lqr = 10
R_kf = [1.0e-6 0; 0 0.001]
Sig = Simulink.Signal()