% Simulink data dictionary globalData.sldd
% references modelConfigData.sldd
% references robotModelData.sldd
% references variantControlsData.sldd
% references kalmanParametersData.sldd
% references controlVariablesData.sldd

Sig = Simulink.Signal()
Sig1 = Simulink.Signal()
Sig2 = Simulink.Signal()

motorEnum = struct(
  Motor_drive_1D=Simulink.VariantControl(ActivationTime="update diagram", ValueType="Numeric"),
  Motor_drive_2D=Simulink.VariantControl(ActivationTime="update diagram", ValueType="Numeric"))