% Simulink data dictionary kalmanParametersData.sldd

q_angle = 0.0001
q_bias = 1.0e-5
q_x = 1.0e-6
q_xdot = 0.001
q_theta = 0.0001
q_thetadot = 0.001
Q_kf = [1.0e-6 0 0 0; 0 0.001 0 0; 0 0 0.0001 0; 0 0 0 0.001]
var_x = 1.0e-6
var_theta = 0.001
R_kf = [1.0e-6 0; 0 0.001]
Q_ang_kf = [0.0001 0 0 0; 0 0 0 0; 0 0 1.0e-5 0; 0 0 0 0]
R_ang_kf = [0.01 0; 0 0.01]

Q_aug_kf = [1.0e-6 0 0 0 0 0
 0 0.001 0 0 0 0
 0 0 1.0e-6 0 0 0
 0 0 0 0.01 0 0
 0 0 0 0 0.001 0
 0 0 0 0 0 0.001]

R_aug_kf = [1.0e-6 0; 0 0.0001]