% Simulink data dictionary robotModelData.sldd
% references motorParametersData.sldd
% references kalmanParametersData.sldd

gyroToUnit = single(14.375)
accelToUnit = single(0.004)
PWMPeriod = single(0.1)
lengthToPendulumCenterOfMass = 0.05
inertiaOfPendulum = 0.0046
wheelBase = single(0.19)
wheelRadius = single(0.03)
massOfCart = 0.36
massOfPendulum = 0.669
CPR = 1092

RobotVariantConfig = Simulink.VariantConfigurationData(
  struct(
    Configurations=struct(
      Name="RobotConfig",
      Description="",
      ControlVariables=[struct(
        Name="controlAlgCtrl",
        Value=Simulink.VariantControl(Value=1, ActivationTime="update diagram", ValueType="Numeric"),
        Source="variantControlsData.sldd"), struct(
        Name="encoderDimCtrl",
        Value=Simulink.VariantControl(Value=1, ActivationTime="update diagram", ValueType="Numeric"),
        Source="variantControlsData.sldd"), struct(
        Name="motorDimCtrl",
        Value=Simulink.VariantControl(Value=1, ActivationTime="update diagram", ValueType="Numeric"),
        Source="variantControlsData.sldd"), struct(
        Name="tiltEstCtrl",
        Value=Simulink.VariantControl(Value=2, ActivationTime="update diagram", ValueType="Numeric"),
        Source="variantControlsData.sldd"), struct(
        Name="controlAlgCtrl",
        Value=Simulink.VariantControl(Value=1, ActivationTime="update diagram", ValueType="Numeric"),
        Source="robotModelData.sldd"), struct(
        Name="encoderDimCtrl",
        Value=Simulink.VariantControl(Value=1, ActivationTime="update diagram", ValueType="Numeric"),
        Source="robotModelData.sldd"), struct(
        Name="motorDimCtrl",
        Value=Simulink.VariantControl(Value=1, ActivationTime="update diagram", ValueType="Numeric"),
        Source="robotModelData.sldd"), struct(
        Name="tiltEstCtrl",
        Value=Simulink.VariantControl(Value=1, ActivationTime="update diagram", ValueType="Numeric"),
        Source="robotModelData.sldd")]),
    VariantConfigurations=struct(
      Name="RobotConfig",
      Description="",
      ControlVariables=[struct(
        Name="controlAlgCtrl",
        Value=Simulink.VariantControl(Value=1, ActivationTime="update diagram", ValueType="Numeric"),
        Source="variantControlsData.sldd"), struct(
        Name="encoderDimCtrl",
        Value=Simulink.VariantControl(Value=1, ActivationTime="update diagram", ValueType="Numeric"),
        Source="variantControlsData.sldd"), struct(
        Name="motorDimCtrl",
        Value=Simulink.VariantControl(Value=1, ActivationTime="update diagram", ValueType="Numeric"),
        Source="variantControlsData.sldd"), struct(
        Name="tiltEstCtrl",
        Value=Simulink.VariantControl(Value=2, ActivationTime="update diagram", ValueType="Numeric"),
        Source="variantControlsData.sldd"), struct(
        Name="controlAlgCtrl",
        Value=Simulink.VariantControl(Value=1, ActivationTime="update diagram", ValueType="Numeric"),
        Source="robotModelData.sldd"), struct(
        Name="encoderDimCtrl",
        Value=Simulink.VariantControl(Value=1, ActivationTime="update diagram", ValueType="Numeric"),
        Source="robotModelData.sldd"), struct(
        Name="motorDimCtrl",
        Value=Simulink.VariantControl(Value=1, ActivationTime="update diagram", ValueType="Numeric"),
        Source="robotModelData.sldd"), struct(
        Name="tiltEstCtrl",
        Value=Simulink.VariantControl(Value=1, ActivationTime="update diagram", ValueType="Numeric"),
        Source="robotModelData.sldd")],
      SubModelConfigurations=[]),
    Constraints=[],
    PreferredConfiguration="",
    DefaultConfigurationName="",
    DataDictionaryName="",
    DataDictionarySection="",
    AreSubModelConfigurationsMigrated=true,
    ComponentConfigurationData=[],
    Version="24.1"))

MaxMotorVoltage = single(12)