% Simulink data dictionary variantControlsData.sldd

tiltEstCtrl = Simulink.VariantControl(
  Value=Simulink.Parameter(Value=tiltEnum.tiltAngleComplementaryFilter, DataType="Enum: tiltEnum"),
  ActivationTime="update diagram",
  ValueType="Simulink.Parameter")

motorDimCtrl = Simulink.VariantControl(
  Value=Simulink.Parameter(Value=driveEnum.Motor_drive_1D, DataType="Enum: driveEnum"),
  ActivationTime="update diagram",
  ValueType="Simulink.Parameter")

encoderDimCtrl = Simulink.VariantControl(
  Value=Simulink.Parameter(Value=encoderDimEnum.Encoder1D, DataType="Enum: encoderDimEnum"),
  ActivationTime="update diagram",
  ValueType="Simulink.Parameter")

mainStateEstCtrl = Simulink.VariantControl(
  Value=Simulink.Parameter(Value=mainStateEnum.Main_Kalman_1D_Augmented_Block, DataType="Enum: mainStateEnum"),
  ActivationTime="update diagram",
  ValueType="Simulink.Parameter")

controlAlgCtrl = Simulink.VariantControl(
  Value=Simulink.Parameter(Value=controlEnum.PID, DataType="Enum: controlEnum"),
  ActivationTime="update diagram",
  ValueType="Simulink.Parameter")

controlAlgStateCtrl = Simulink.VariantControl(
  Value=Simulink.Parameter(Value=controlEnumState.MPC_control, DataType="Enum: controlEnumState"),
  ActivationTime="update diagram",
  ValueType="Simulink.Parameter")